# Grasshopper definition client.gh (Grasshopper 1.0.7)

file_path = FilePath("F:\02_projects\YangDaShiTouBiao\geojson\YangDaShiTouBiao.json")
unit_z = UnitZ(Factor=1)
read_file = ReadFile(File=file_path, PerLineParse=True)
ghpython_script = GhPythonScript(x=read_file)  # -> out, plys, heights
# ---------- ghpython_script: Python ----------
__author__ = "wenhs"
__version__ = "2020.08.10"


import rhinoscriptsyntax as rs


data = eval(x)
plys = list()
heights = list()


for each in data:
    ps, h = each['l'], each['h']
    pts = [rs.AddPoint(*p) for p in ps]
    ply = rs.AddPolyline(pts + [pts[0]])
    plys.append(ply)
    heights.append(h)
# ---------- end ghpython_script ----------
scale = Scale(Geometry=unit_z, Center=Point(0, 0, 0), Factor=ghpython_script.heights)  # -> Geometry, Transform
extrude = Extrude(Base=ghpython_script.plys, Direction=scale.Geometry)
cap_holes = CapHoles(Brep=extrude)
mesh_brep = MeshBrep(
    Brep=cap_holes,
    Settings={GridMaxCount=0, GridMinCount=16, JaggedSeams=False, MaxEdgeLength=0, MinEdgeLength=0.0001, MinTolerance=0, Refine=True, RefineAngle=0, RelativeTolerance=0.65, SimplePlanes=True, Tolerance=0})

# ---- group: Create Terrain
file_path_2 = FilePath("F:\02_projects\ChangShaShiYiYiYuan\mesh\terrain.json")
read_file_2 = ReadFile(File=file_path_2, PerLineParse=True)
ghpython_script_2 = GhPythonScript(x=read_file_2)  # -> out, a
# ---------- ghpython_script_2: Python ----------
__author__ = "wenhs"
__version__ = "2020.08.07"

import rhinoscriptsyntax as rs


data = eval(x)
a = [rs.AddMesh(d['v'], d['f']) for d in data]
# ---------- end ghpython_script_2 ----------
rotate = Rotate(Geometry=ghpython_script_2.a, Angle=-1.570796327, Plane=PlaneXY(0, 0, 0))  # -> Geometry, Transform

# ---- group: Clear the gaps
demesh = DeconstructMesh(Mesh=rotate.Geometry)  # -> Vertices, Faces, Colours, Normals
pt = Point(flatten(demesh.Vertices))
cullpt = CullDuplicates(Points=pt, Tolerance="5000", CullMode=3)  # -> Points, Indices, Valence
cp = ClosestPoint(Point=demesh.Vertices, Cloud=cullpt.Points)  # -> ClosestPoint, CPIndex, Distance
conmesh = ConstructMesh(Vertices=cp.ClosestPoint, Faces=demesh.Faces)  # -> flatten(Mesh)

# ----
mesh_join = MeshJoin(Meshes=conmesh)
bounding_box = BoundingBox(Content=mesh_join, Plane=PlaneXY(0, 0, 0))  # -> Box, Box_2
bounding_box_2 = BoundingBox(Content=mesh_brep, Plane=PlaneXY(0, 0, 0))  # -> Box, Box_2
evaluate_box = EvaluateBox(Box=bounding_box_2.Box, UParameter=0.5, VParameter=0.5, WParameter="0")  # -> Plane, Point, Include
mesh_ray = MeshRay(Mesh=mesh_join, Point=evaluate_box.Point, Direction=unit_z)  # -> Point, Hit
ghpython_script_3 = GhPythonScript(meshes=mesh_brep, crossed=mesh_ray.Point, original=evaluate_box.Point)  # -> out, a; inputs meshes: list of Mesh, crossed: list of Point3d, original: list of Point3d
# ---------- ghpython_script_3: Python ----------
__author__ = "wenhs"
__version__ = "2020.08.11"

import rhinoscriptsyntax as rs

a = list()

for i in range(len(meshes)):
    mesh = meshes[i]
    p1 = crossed[i]
    p2 = original[i]

    if p1 is not None:
        v = p1 - p2
        m = rs.MoveObject(mesh, v)
        a.append(m)
# ---------- end ghpython_script_3 ----------
