# Grasshopper definition create_mesh.gh (Grasshopper 1.0.5)

file_path = FilePath("C:\Users\wenhs\Desktop\KeXueChengSanQi\terrain_mesh.json")
read_file = ReadFile(File=file_path, PerLineParse=True)
ghpython_script = GhPythonScript(x=read_file)  # -> out, a
# ---------- ghpython_script: Python ----------
__author__ = "wenhs"
__version__ = "2020.07.31"

import rhinoscriptsyntax as rs


data = eval(x)
a = [rs.AddMesh(mesh['v'], mesh['f']) for mesh in data]
# ---------- end ghpython_script ----------
