# Grasshopper definition line_based_finite_grid.gh (Grasshopper 1.0.4)

file_path = FilePath("C:\Users\wenhs\Desktop\ChangShaTerrain.txt")
read_file = ReadFile(File=file_path, PerLineParse=True)
ghpython_script = GhPythonScript(meshes=read_file)  # -> out, ms
# ---------- ghpython_script: Python ----------
__author__ = "wenhs"
__version__ = "2020.06.04"

import rhinoscriptsyntax as rs

meshes = eval(meshes)

ms = [rs.AddMesh(mesh['v'], mesh['f']) for mesh in meshes]
# ---------- end ghpython_script ----------
